# Grasshopper definition pts_txt_from_geometry.ghx (Grasshopper 1.0.7)

mesh = Mesh(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)
list = ValueList({"100", "1000", "10000", "20000"}, selected="1000")
popgeo = PopulateGeometry(Geometry=mesh, Count=list, Seed=1)
dam = DataDam(DataA=popgeo, BufferDelay=10000000, BufferMode=0)
pt = Point(dam)
python = GhPythonScript(POINTS=dam, FILE_PATH="C:\Users\ysoky\Documents\Mesh_Voxel_Color\_pts_\pts.txt", EXPORT=Button())  # -> out; inputs POINTS: list
# ---------- python: Python ----------
import rhinoscriptsyntax as rs

def export_txt(file_path, txt):
    with open(file_path, 'w') as f:
        f.writelines(txt)
    print("EXPORT :", file_path)


pts = rs.coerce3dpointlist(POINTS)


txt = []

for i in xrange(len(pts)):
    p = pts[i]
    # print(p)
    
    ### Not Last-Index
    if i != (len(pts) -1):
        t = "{:.4f}, {:.4f}, {:.4f}\n".format(p[0], p[1], p[2])
    
    ### Last-Index
    else:
        t = "{:.4f}, {:.4f}, {:.4f}".format(p[0], p[1], p[2])
    
    txt.append(t)

if EXPORT:
    export_txt(FILE_PATH, txt)

#print(txt)
# ---------- end python ----------
panel = Panel(python)
